# Grasshopper definition atrium_hops.gh (Grasshopper 1.0.7)
# plug-ins: Hops

number_slider = Slider(0.7, range=0..1)
number_slider_2 = Slider(2, range=0..10)
hops = Hops(
    _Path="http://8239-34-74-144-135.ngrok.io/myAtriumDaylighting",
    TypicalFacadeGlazingRatio=number_slider,
    TypicalFacadeWindowWidth=number_slider_2,
    GroundFacadeGlazingRatio=number_slider,
    GroundFacadeWindowWidth=number_slider_2,
    BuildingDepth=Slider(25, range=0..100),
    BalconyWidth=Slider(2, range=0..10),
    AtriumArea=Slider(2000, range=0..10000),
    AspectRatio=Slider(1, range=0..1),
    GroundFloorHeight=Slider(5, range=0..10),
    TypicalfloorHeight=Slider(3, range=0..10),
    NumberLevels=Slider(5, range=0..10),
    CacheResultsInMemory=True,
    CacheSolveResults=True,
    RemoteDefinitionLocation="http://8239-34-74-144-135.ngrok.io/myAtriumDaylighting",
    RemoteSolveVersion=(0, 1, 0),
    ShowInput_Enabled=False,
    ShowInput_Path=True,
    SynchronousSolve=True)  # -> GroundSDA, FirstSDA, GroundASE, FirstASE, GroundViewPercentage, FirstViewPercentage
panel = Panel(hops.GroundSDA)
panel_2 = Panel(hops.FirstSDA)
panel_3 = Panel(hops.FirstViewPercentage)
panel_4 = Panel(hops.FirstASE)
panel_5 = Panel(hops.GroundASE)
panel_6 = Panel(hops.GroundViewPercentage)
