# Grasshopper definition atrium_hops.gh (Grasshopper 1.0.7)
# plug-ins: Hops

number_slider = Slider(20, range=15..40)
number_slider_2 = Slider(1, range=1..3)
number_slider_3 = Slider(0.7, range=0.7..0.9)
number_slider_4 = Slider(1.2, range=0.5..1.5)
number_slider_5 = Slider(1, range=1..3)
number_slider_6 = Slider(1, range=1..6)
number_slider_7 = Slider(0.7, range=0.7..0.9)
number_slider_8 = Slider(3327, range=1500..4000)
number_slider_9 = Slider(2.6, range=2.5..3)
number_slider_10 = Slider(3, range=3..6)
number_slider_11 = Slider(9, range=1..10)
hops = Hops(
    _Path="http://fad9-34-91-69-209.ngrok.io/myAtriumDaylighting",
    TypicalFacadeGlazingRatio=number_slider_3,
    TypicalFacadeWindowWidth=number_slider_5,
    GroundFacadeGlazingRatio=number_slider_7,
    GroundFacadeWindowWidth=number_slider_2,
    BuildingDepth=number_slider,
    BalconyWidth=number_slider_6,
    AtriumArea=number_slider_8,
    AspectRatio=number_slider_4,
    GroundFloorHeight=number_slider_10,
    TypicalfloorHeight=number_slider_9,
    NumberLevels=number_slider_11,
    CacheResultsInMemory=True,
    CacheSolveResults=True,
    RemoteDefinitionLocation="http://fad9-34-91-69-209.ngrok.io/myAtriumDaylighting",
    RemoteSolveVersion=(0, 1, 0),
    ShowInput_Enabled=False,
    ShowInput_Path=True,
    SynchronousSolve=True)  # -> GroundSDA, FirstSDA, GroundASE, FirstASE, GroundViewPercentage, FirstViewPercentage
atrium_geometry = AtriumGeometry(
    relay_8=number_slider_3,
    relay_9=number_slider_5,
    relay_11=number_slider_7,
    relay_10=number_slider_2,
    relay_3=number_slider,
    relay_4=number_slider_6,
    relay_2=number_slider_8,
    relay=number_slider_4,
    relay_5=number_slider_10,
    relay_6=number_slider_9,
    relay_7=number_slider_11)  # -> surface_9, relay_12, surface_6, surface_14, surface_16, surface_19
custom_preview = CustomPreview(Geometry=[atrium_geometry.surface_16, atrium_geometry.surface_19], Material=ColourSwatch(SwatchColor=RGB(171, 171, 171)))
custom_preview_2 = CustomPreview(
    Geometry=[atrium_geometry.surface_9, atrium_geometry.relay_12, atrium_geometry.surface_6, atrium_geometry.surface_14],
    Material=ColourSwatch(SwatchColor=RGBA(45, 38, 252, 41)))
panel = Panel(hops.GroundSDA)
panel_2 = Panel(hops.FirstSDA)
panel_3 = Panel(hops.GroundASE)
panel_4 = Panel(hops.FirstViewPercentage)
panel_5 = Panel(hops.FirstASE)
panel_6 = Panel(hops.GroundViewPercentage)

# ==== cluster AtriumGeometry
relay = ClusterInput()
relay_2 = ClusterInput()
relay_3 = ClusterInput()
relay_4 = ClusterInput()
relay_5 = ClusterInput()
relay_6 = ClusterInput()
relay_7 = ClusterInput()
relay_8 = ClusterInput()
relay_9 = ClusterInput()
relay_10 = ClusterInput()
relay_11 = ClusterInput()
xy_plane = XYPlane(Origin=Point(0, 0, 0))
rh_in_groundfacadeglazingratio = GetNumber(relay_11, AtLeast=1, AtMost=1, Maximum=1.797693135e+308, Minimum=-1.797693135e+308)
rh_in_groundfacadewindowwidth = GetInteger(relay_10, AtLeast=1, AtMost=1, Maximum=2147483647, Minimum=-2147483648)
rh_in_buildingdepth = GetInteger(relay_3, AtLeast=1, AtMost=1, Maximum=24, Minimum=12, Prompt="Enter Building depth (must be between 12m and 24m)")
rh_in_typicalfacadeglazingratio = GetNumber(relay_8, AtLeast=1, AtMost=1, Maximum=1.797693135e+308, Minimum=-1.797693135e+308)
rh_in_balcony_roof_offset = GetInteger(relay_4, AtLeast=1, AtMost=10, Maximum=24, Minimum=12, Prompt="Enter Building depth (must be between 12m and 24m)")
rh_in_typicalfacadewindowwidth = GetInteger(relay_9, AtLeast=1, AtMost=1, Maximum=2147483647, Minimum=-2147483648)
rh_in_levelnumber = GetInteger(relay_7, AtLeast=1, AtMost=1, Maximum=20, Minimum=2, Prompt="Enter Number of Floors (must be between 2 and 20)")
rh_in_groundheight = GetNumber(relay_5, AtLeast=1, AtMost=1, Maximum=1.797693135e+308, Minimum=-1.797693135e+308)
rh_in_floorheight = GetNumber(relay_6, AtLeast=1, AtMost=1, Maximum=1.797693135e+308, Minimum=-1.797693135e+308)
rh_in_aspectratio = GetNumber(relay, AtLeast=1, AtMost=1, Maximum=1.797693135e+308, Minimum=-1.797693135e+308)
rh_in_atriumarea = GetInteger(relay_2, AtLeast=1, AtMost=1, Maximum=300, Minimum=150, Prompt="Enter Site Length (between 150m and 300m)")
square_root = SquareRoot(Value=rh_in_atriumarea)
multiplication = Multiplication(A=square_root, B=rh_in_aspectratio)
division = Division(A=rh_in_atriumarea, B=multiplication)
rectangle = Rectangle(Plane=PlaneXY(0, 0, 0), XSize=multiplication, YSize=division, Radius=0)  # -> simplify(Rectangle), Length
area = Area(Geometry=rectangle.Rectangle)  # -> Area, Centroid
orient = Orient(Geometry=rectangle.Rectangle, Source=area.Centroid, Target=xy_plane)  # -> Geometry, Transform
offset_curve = OffsetCurve(Curve=orient.Geometry, Plane=PlaneXY(0, 0, 0), Distance=rh_in_buildingdepth, BothSides=0, Kinks=0, CapType=1)  # -> simplify(Offset)
number_slider = Slider(0.3, range=0..1)

rh_in_balcony_depth = GetNumber(number_slider, AtLeast=1, AtMost=1, Maximum=1.797693135e+308, Minimum=-1.797693135e+308)
rh_in_floor_depth = GetNumber(number_slider, AtLeast=1, AtMost=1, Maximum=1.797693135e+308, Minimum=-1.797693135e+308)

pshift = ShiftPaths(Data=offset_curve, Offset=-1)
explode = Explode(Curve=pshift, Recursive=True)  # -> Segments, Vertices
loft = Loft(
    Curves=[pshift, orient.Geometry],
    Options={Adjust=False, Closed=False, LoftEnds=0, LoftSimp=0, LoftType=0, Rebuild=10, Refit=0.01})  # -> graft(Loft)
crv = Curve(explode.Segments)
edges = BrepEdges(Brep=loft)  # -> Naked, Interior, NonManifold
crv_2 = Curve(edges.Naked)
rh_in_skylight_roof_offset = GetInteger("0", AtLeast=1, AtMost=1, Maximum=24, Minimum=12, Prompt="Enter Building depth (must be between 12m and 24m)")

# ---- group: skylight
series = Series(Start=rh_in_groundheight, Step=rh_in_floorheight, Count=rh_in_levelnumber)
list_item = ListItem(List=series, Index=expr("-1", 0), Wrap=True)
addition = Addition(A=list_item, B=rh_in_floorheight)
unit_z = UnitZ(Factor=addition)
curve = Curve(orient.Geometry)
move = Move(Geometry=curve, Motion=unit_z)  # -> Geometry, Transform
unit_z_2 = UnitZ(Factor=rh_in_skylight_roof_offset)
move_2 = Move(Geometry=move.Geometry, Motion=unit_z_2)  # -> Geometry, Transform
curve_2 = Curve(move_2.Geometry)
loft_2 = Loft(
    Curves=[move_2.Geometry, move.Geometry],
    Options={Adjust=False, Closed=False, LoftEnds=0, LoftSimp=0, LoftType=0, Rebuild=10, Refit=0.01})
surface = Surface(curve_2)

# ----
unit_z_3 = UnitZ(Factor=addition)
crv_3 = Curve(crv_2)
boundary = BoundarySurfaces(Edges=crv_3)
srfsplit = SurfaceSplit(Surface=boundary, Curves=crv)  # -> simplify(Fragments)
curve_3 = Curve(move.Geometry)

# ---- group: typical floor volume
Z = UnitZ(Factor=series)
move_3 = Move(Geometry=srfsplit, Motion=Z)  # -> simplify(Geometry), Transform
repeat = RepeatData(Data=rh_in_floorheight, Length=rh_in_levelnumber)
lng = ListLength(List=move_3.Geometry)
series_2 = Series(Start=0, Step=1, Count=lng)
Z_2 = UnitZ(Factor=1)
replace = ReplaceItems(List=move_3.Geometry, Item=repeat, Indices=series_2, Wrap=False)
amp = Amplitude(Vector=Z_2, Amplitude=replace)  # -> simplify(Vector)

# ----
move_4 = Move(Geometry=offset_curve, Motion=unit_z_3)  # -> Geometry, Transform
boundary_surfaces = BoundarySurfaces(Edges=[curve_3, move_4.Geometry])
unit_z_4 = UnitZ(Factor=rh_in_floor_depth)
deconstruct_brep = DeconstructBrep(Brep=boundary_surfaces)  # -> Faces, Edges, Vertices
subtraction = Subtraction(A=rh_in_floorheight, B=rh_in_floor_depth)
negative = Negative(Value=unit_z_4)
unit_z_5 = UnitZ(Factor=rh_in_floor_depth)
unit_z_6 = UnitZ(Factor=subtraction)
join_curves = JoinCurves(Curves=crv, Preserve=False)
surface_2 = Surface(deconstruct_brep.Faces)
crv_4 = Curve(simplify(flatten(offset_curve)))
subtraction_2 = Subtraction(A=rh_in_groundheight, B=rh_in_floor_depth)
move_5 = Move(Geometry=surface_2, Motion=negative)  # -> Geometry, Transform
negative_2 = Negative(Value=unit_z_5)

# ---- group: Central plaza
surface_3 = Surface(join_curves)

# ----
Z_3 = UnitZ(Factor=subtraction_2)

# ---- group: skylight / Skylight
merge = Merge(Data1=loft_2, Data2=surface)

# ----
relay_12 = ClusterOutput(merge)
curve_4 = Curve(flatten(surface_3))
curve_5 = Curve(flatten(orient.Geometry))
offset_surface = OffsetSurface(Surface=move_5.Geometry, Distance=unit_z_5, BothSides=0, CreateSolid=True)
extr = Extrude(Base=crv_4, Direction=Z_3)
boundary_surfaces_2 = BoundarySurfaces(Edges=[curve_4, curve_5])

# ---- group: typical floor volume / Typical Floor volumes
extr_2 = Extrude(Base=move_3.Geometry, Direction=amp)  # -> flatten(Extrusion)

# ---- group: Roof
custom_preview = CustomPreview(Geometry=offset_surface, Material=ColourSwatch(SwatchColor=RGB(186, 182, 182)))

# ---- group: Ground usable floor
surface_4 = Surface(boundary_surfaces_2)

# ----
deconstruct_brep_2 = DeconstructBrep(Brep=offset_surface)  # -> Faces, Edges, Vertices

# ---- group: Ground outer facade
deconstruct_brep_3 = DeconstructBrep(Brep=extr)  # -> Faces, Edges, Vertices

# ----
area_2 = Area(Geometry=deconstruct_brep_2.Faces)  # -> Area, Centroid
deconstruct = Deconstruct(Point=area_2.Centroid)  # -> XComponent, YComponent, ZComponent
sort_list = SortList(Keys=deconstruct.ZComponent, ValuesValuesA=deconstruct_brep_2.Faces)  # -> Keys, ValuesValuesA

# ---- group: roof ceiling
list_item_2 = ListItem(List=sort_list.ValuesValuesA, Index=0, Wrap=True)

# ---- group: Roof
geometry = Geometry(offset_surface)

# ---- group: ground floor
sitegeometry = Geometry(surface_4)

# ----
ground_outer_facade = Data(deconstruct_brep_3.Faces)
data = Data(ground_outer_facade)
surface_5 = Surface(data)
surface_6 = ClusterOutput(surface_5)

# ---- group: balcony
unit_z_7 = UnitZ(Factor=series)
move_6 = Move(Geometry=curve, Motion=unit_z_7)  # -> simplify(Geometry), Transform
negative_3 = Negative(Value=rh_in_balcony_roof_offset)
offset_curve_2 = OffsetCurve(Curve=move_6.Geometry, Distance=negative_3, Corners=1)  # -> simplify(Curve)
graft_tree = GraftTree(Tree=move_6.Geometry, IncludeEmptyLists=True, IncludeNullItems=True)
graft_tree_2 = GraftTree(Tree=offset_curve_2, IncludeEmptyLists=True, IncludeNullItems=True)
insert_items = InsertItems(List=graft_tree, Item=graft_tree_2, Indices="0", Wrap=True)  # -> simplify(List)
negative_4 = Negative(Value=rh_in_balcony_depth)

# ----
move_7 = Move(Geometry=offset_curve, Motion=unit_z_7)  # -> simplify(Geometry), Transform

# ---- group: balcony / Balconies
boundary_surfaces_3 = BoundarySurfaces(Edges=insert_items)

# ----
extrude = Extrude(Base=move_7.Geometry, Direction=unit_z_6)

# ---- group: balcony (continued)
offset_surface_2 = OffsetSurface(Surface=boundary_surfaces_3, Distance=negative_4, BothSides=0, CreateSolid=True)
custom_preview_2 = CustomPreview(Geometry=offset_surface_2, Material=ColourSwatch(SwatchColor=RGB(255, 72, 69)))

# ----
brep = Brep(offset_surface_2)
deconstruct_brep_4 = DeconstructBrep(Brep=brep)  # -> Faces, Edges, Vertices
area_3 = Area(Geometry=deconstruct_brep_4.Faces)  # -> Area, Centroid
deconstruct_2 = Deconstruct(Point=area_3.Centroid)  # -> XComponent, YComponent, ZComponent
sort_list_2 = SortList(Keys=deconstruct_2.ZComponent, ValuesValuesA=deconstruct_brep_4.Faces)  # -> Keys, ValuesValuesA
deconstruct_brep_5 = DeconstructBrep(Brep=extrude)  # -> Faces, Edges, Vertices

# ---- group: balcony ceiling
list_item_3 = ListItem(List=sort_list_2.ValuesValuesA, Index=0, Wrap=True)

# ---- group: Typical outer facade
surface_7 = Surface(deconstruct_brep_5.Faces)

# ----
typical_outer_facade = Data(surface_7)
surface_8 = Surface(typical_outer_facade)
surface_9 = ClusterOutput(surface_8)

# ---- group: Floors
curve_6 = Curve(offset_curve)
unit_z_8 = UnitZ(Factor=series)
move_8 = Move(Geometry=curve_6, Motion=unit_z_8)  # -> simplify(Geometry), Transform
graft_tree_3 = GraftTree(Tree=move_8.Geometry, IncludeEmptyLists=True, IncludeNullItems=True)
insert_items_2 = InsertItems(List=graft_tree_3, Item=graft_tree, Indices="0", Wrap=True)  # -> simplify(List)
negative_5 = Negative(Value=rh_in_floor_depth)
boundary_surfaces_4 = BoundarySurfaces(Edges=insert_items_2)

offset_surface_3 = OffsetSurface(Surface=boundary_surfaces_4, Distance=negative_5, BothSides=0, CreateSolid=True)

# ----
brep_2 = Brep(offset_surface_3)
deconstruct_brep_6 = DeconstructBrep(Brep=brep_2)  # -> Faces, Edges, Vertices
deconstruct_brep_7 = DeconstructBrep(Brep=offset_surface_3)  # -> Faces, Edges, Vertices
area_4 = Area(Geometry=deconstruct_brep_6.Faces)  # -> Area, Centroid
deconstruct_3 = Deconstruct(Point=area_4.Centroid)  # -> XComponent, YComponent, ZComponent
area_5 = Area(Geometry=deconstruct_brep_7.Faces)  # -> Area, Centroid
deconstruct_4 = Deconstruct(Point=area_5.Centroid)  # -> XComponent, YComponent, ZComponent
sort_list_3 = SortList(Keys=deconstruct_3.ZComponent, ValuesValuesA=deconstruct_brep_6.Faces)  # -> Keys, ValuesValuesA
sort_list_4 = SortList(Keys=deconstruct_4.ZComponent, ValuesValuesA=deconstruct_brep_7.Faces)  # -> Keys, ValuesValuesA

# ---- group: Ground ceiling
list_item_4 = ListItem(List=sort_list_3.ValuesValuesA, Index=0, Wrap=True)

# ---- group: floor surface
list_item_5 = ListItem(List=sort_list_4.ValuesValuesA, Index=expr("-1", 0), Wrap=True)  # -> simplify(Item)

# ---- group: Floors (continued)
custom_preview_3 = CustomPreview(Geometry=offset_surface_3, Material=ColourSwatch(SwatchColor=RGB(255, 196, 0)))

# ----
merge_2 = Merge(Data1=list_item_4, Data2=list_item_3)

# ---- group: all ceilings
surface_10 = Surface(merge_2)

surface_11 = Surface([surface_10, list_item_2])

# ---- group: upper floor surfaces
surface_12 = Surface(list_item_5)

# ----
merge_3 = Merge(Data1=sitegeometry, Data2=surface_12)  # -> flatten(Result)
surface_13 = Surface(merge_3)
surface_14 = ClusterOutput(surface_13)
surface_15 = Surface(surface_11)
surface_16 = ClusterOutput(surface_15)

# ---- group: inner facades
subtraction_3 = Subtraction(A=rh_in_floorheight, B=rh_in_floor_depth)
unit_z_9 = UnitZ(Factor=subtraction_3)
subtraction_4 = Subtraction(A=rh_in_groundheight, B=rh_in_floor_depth)
crv_5 = Curve(simplify(flatten(orient.Geometry)))
extrude_2 = Extrude(Base=graft_tree, Direction=unit_z_9)
Z_4 = UnitZ(Factor=subtraction_4)
deconstruct_brep_8 = DeconstructBrep(Brep=extrude_2)  # -> Faces, Edges, Vertices

# ---- group: inner facades / Ground inner facade
extr_3 = Extrude(Base=crv_5, Direction=Z_4)

# ---- group: inner facades / Typical inner facade
surface_17 = Surface(deconstruct_brep_8.Faces)

# ---- group: inner facades (continued)
deconstruct_brep_9 = DeconstructBrep(Brep=extr_3)  # -> Faces, Edges, Vertices

# ---- group: inner facades / all inner facades
merge_4 = Merge(Data1=surface_17, Data2=deconstruct_brep_9.Faces)  # -> flatten(Result)
custom_preview_4 = CustomPreview(Geometry=[surface_17, extr_3], Material=ColourSwatch(SwatchColor=RGBA(8, 0, 252, 152)))

# ---- group: internal glazing
geometry_2 = Geometry(merge_4)

# ----
surface_18 = Surface(geometry_2)
surface_19 = ClusterOutput(surface_18)
