# Grasshopper definition atrium_simplified_SDA+ASE+Wallacei.gh (Grasshopper 1.0.7)
# plug-ins: Pufferfish, LunchBox, Wallacei

boolean_toggle = BooleanToggle(False)
toggle = BooleanToggle(False)

# ---- group: Generate your random parameter state
number_of_samples = Slider(1000, range=0..1000)
seed = Slider(1, range=0..10)
python = GhPythonScript(x=number_of_samples, y=seed)  # -> out, valueList; inputs x: Int32, y: Int32
# ---------- python: Python ----------
__author__ = "garo"
__version__ = "2021.04.26"

import Rhino.Geometry as rg
import random

valueList = []
s= random.seed(y)



for j in range(x):
    sub = []
    #random atrium area
    atriumArea=random.randrange(1000,4000,100)
    sub.append(atriumArea)
    
    #random aspect ratio
    sub.append(round(random.uniform(0.5,1.5),1))
    
    
    #random building depth
    sub.append(random.randint(15,40))

    
        #random sky roof offset
    sub.append(random.randint(1,10))
        #random balcony offset
    sub.append(random.randint(1,6))
        
        #random floor depth
    sub.append(round(random.uniform(0.3,1.0),1))
        
        #random ground floor height
    sub.append(round(random.uniform(3.0,6.0),1))
        #random typical floor height
    sub.append(round(random.uniform(2.5,3.0),1))
        #random building levels
    sub.append(random.randint(1,10))
    
            #random upper level glazing ratio
    sub.append(round(random.uniform(0.7,0.9),1))
            #random upper level window width
    sub.append(random.randint(2,4))
    
                #random ground level glazing ratio
    sub.append(round(random.uniform(0.7,0.9),1))
            #random ground level window width
    sub.append(random.randint(2,4))
    
    #triangleSublist
    valueList.append(sub)
# ---------- end python ----------
python_2 = GhPythonScript(x=python.valueList)  # -> out, simplify(a)
# ---------- python_2: Python ----------
__author__ = "rossi"
__version__ = "2020.02.04"

import rhinoscriptsyntax as rs
a = x
# ---------- end python_2 ----------

# ---- group: Animate Me
# Atrium Type
number_slider = Slider(0, range=0..999)

# ----
branch = TreeBranch(Tree=python_2.a, Path=number_slider, MaintainPaths=True)
panel = Panel(branch)
item = ListItem(List=branch, Index=0, Wrap=True)  # -> Item, Item1, Item2, Item3, Item4, Item5, Item6, Item7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
wlc_4 = Slider(7, range=1..10)
wlc_5 = Slider(5, range=1..6)
wlc_3 = Slider(37, range=15..40)
wlc_2 = Slider(0.6, range=0.5..1.5)
wlc_1 = Slider(3064, range=1000..4000)
wlc_8 = Slider(1, range=1..10)
wlc_6 = Slider(6, range=3..6)
wlc_7 = Slider(3.4, range=2.5..3.5)
wlc_9 = Slider(0.7, range=0.7..0.9)
wlc_10 = Slider(3, range=2..4)
wlc_11 = Slider(0.8, range=0.7..0.9)
wlc_12 = Slider(3, range=2..4)

rh_in_balcony_roof_offset = GetInteger(wlc_5, AtLeast=1, AtMost=10, Maximum=24, Minimum=12, Prompt="Enter Building depth (must be between 12m and 24m)")
rh_in_skylight_roof_offset = GetInteger(wlc_4, AtLeast=1, AtMost=1, Maximum=24, Minimum=12, Prompt="Enter Building depth (must be between 12m and 24m)")

rh_in_aspectratio = GetNumber(wlc_2, AtLeast=1, AtMost=1, Maximum=1.797693135e+308, Minimum=-1.797693135e+308)

rh_in_buildingdepth = GetInteger(wlc_3, AtLeast=1, AtMost=1, Maximum=24, Minimum=12, Prompt="Enter Building depth (must be between 12m and 24m)")
rh_in_atriumarea = GetInteger(wlc_1, AtLeast=1, AtMost=1, Maximum=300, Minimum=150, Prompt="Enter Site Length (between 150m and 300m)")

rh_in_typicalfacadewindowwidth = GetInteger(wlc_10, AtLeast=1, AtMost=1, Maximum=2147483647, Minimum=-2147483648)
rh_in_typicalfacadeglazingratio = GetNumber(wlc_9, AtLeast=1, AtMost=1, Maximum=1.797693135e+308, Minimum=-1.797693135e+308)

rh_in_groundheight = GetNumber(wlc_6, AtLeast=1, AtMost=1, Maximum=1.797693135e+308, Minimum=-1.797693135e+308)
rh_in_levelnumber = GetInteger(wlc_8, AtLeast=1, AtMost=1, Maximum=20, Minimum=2, Prompt="Enter Number of Floors (must be between 2 and 20)")

rh_in_groundfacadewindowwidth = GetInteger(wlc_12, AtLeast=1, AtMost=1, Maximum=2147483647, Minimum=-2147483648)
rh_in_groundfacadeglazingratio = GetNumber(wlc_11, AtLeast=1, AtMost=1, Maximum=1.797693135e+308, Minimum=-1.797693135e+308)

rh_in_floorheight = GetNumber(wlc_7, AtLeast=1, AtMost=1, Maximum=1.797693135e+308, Minimum=-1.797693135e+308)
number_slider_2 = Slider(0.3, range=0..1)

rh_in_balcony_depth = GetNumber(number_slider_2, AtLeast=1, AtMost=1, Maximum=1.797693135e+308, Minimum=-1.797693135e+308)
rh_in_floor_depth = GetNumber(number_slider_2, AtLeast=1, AtMost=1, Maximum=1.797693135e+308, Minimum=-1.797693135e+308)

square_root = SquareRoot(Value=rh_in_atriumarea)
rh_in_northdirection = GetInteger(
    Slider(0, range=0..100),
    AtLeast=1,
    AtMost=1,
    Maximum=20,
    Minimum=2,
    Prompt="Enter Number of Floors (must be between 2 and 20)")
multiplication = Multiplication(A=square_root, B=rh_in_aspectratio)
division = Division(A=rh_in_atriumarea, B=multiplication)
rectangle = Rectangle(Plane=PlaneXY(0, 0, 0), XSize=multiplication, YSize=division, Radius=0)  # -> simplify(Rectangle), Length
area = Area(Geometry=rectangle.Rectangle)  # -> Area, Centroid
xy_plane = XYPlane(Origin=Point(0, 0, 0))
orient = Orient(Geometry=rectangle.Rectangle, Source=area.Centroid, Target=xy_plane)  # -> Geometry, Transform
offset_curve = OffsetCurve(Curve=orient.Geometry, Plane=PlaneXY(0, 0, 0), Distance=rh_in_buildingdepth, BothSides=0, Kinks=0, CapType=1)  # -> simplify(Offset)
pshift = ShiftPaths(Data=offset_curve, Offset=-1)
explode = Explode(Curve=pshift, Recursive=True)  # -> Segments, Vertices
crv = Curve(explode.Segments)
loft = Loft(
    Curves=[pshift, orient.Geometry],
    Options={Adjust=False, Closed=False, LoftEnds=0, LoftSimp=0, LoftType=0, Rebuild=10, Refit=0.01})  # -> graft(Loft)
edges = BrepEdges(Brep=loft)  # -> Naked, Interior, NonManifold
crv_2 = Curve(edges.Naked)
crv_3 = Curve(crv_2)
subtraction = Subtraction(A=rh_in_floorheight, B=rh_in_floor_depth)
unit_z = UnitZ(Factor=subtraction)
boundary = BoundarySurfaces(Edges=crv_3)
crv_4 = Curve(simplify(flatten(offset_curve)))
subtraction_2 = Subtraction(A=rh_in_groundheight, B=rh_in_floor_depth)
srfsplit = SurfaceSplit(Surface=boundary, Curves=crv)  # -> simplify(Fragments)
Z = UnitZ(Factor=subtraction_2)
extr = Extrude(Base=crv_4, Direction=Z)

# ---- group: Ground outer facade
deconstruct_brep = DeconstructBrep(Brep=extr)  # -> Faces, Edges, Vertices

# ----
unit_z_2 = UnitZ(Factor=rh_in_floor_depth)
negative = Negative(Value=unit_z_2)
unit_z_3 = UnitZ(Factor=rh_in_floor_depth)
join_curves = JoinCurves(Curves=crv, Preserve=False)
negative_2 = Negative(Value=unit_z_3)

# ---- group: Central plaza
surface = Surface(join_curves)

# ----
curve = Curve(flatten(surface))
curve_2 = Curve(flatten(orient.Geometry))
boundary_surfaces = BoundarySurfaces(Edges=[curve, curve_2])

# ---- group: Ground usable floor
surface_2 = Surface(boundary_surfaces)

# ----
ground_outer_facade = Data(deconstruct_brep.Faces)

# ---- group: ground floor
sitegeometry = Geometry(surface_2)

# ----
shuffler = GenePoolAndSliderShuffler(BooleanButton=Button())
colour_swatch = ColourSwatch(SwatchColor=RGBA(189, 255, 253, 101))  # disabled
data = Data(ground_outer_facade)
surface_3 = Surface(data)
reflectance = Panel("0.35")
reflectance_2 = Panel("0.35")
opaquemod = HBOpaqueModifier(name="extWallsMat", reflect=reflectance)  # -> modifier; plug-in component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
opaquemod_2 = HBOpaqueModifier(name="extWallsMat", reflect=reflectance_2)  # -> modifier; plug-in component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
reflectance_3 = Panel("0.4")
reflectance_4 = Panel("0.3")
reflectance_5 = Panel("0.4")
opaquemod_3 = HBOpaqueModifier(name="intWallsGlazedMat", reflect=reflectance_3)  # -> modifier; plug-in component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
face = HBFace(geo=surface_3, rad_mod=opaquemod_2)  # -> out, faces; plug-in component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
surface_4 = Surface(surface_2)
opaquemod_4 = HBOpaqueModifier(name="floorMat", reflect=reflectance_4)  # -> modifier; plug-in component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
opaquemod_5 = HBOpaqueModifier(name="ceilingMat", reflect=reflectance_5)  # -> modifier; plug-in component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
subtraction_3 = Subtraction(A=rh_in_floorheight, B="0.2")
subtraction_4 = Subtraction(A=rh_in_groundheight, B="0.2")

# ---- group: external ground floor
aperturesbyratio = HBAperturesByRatio(
    hb_objs=flatten(face.faces),
    ratio=rh_in_groundfacadeglazingratio,
    win_height=subtraction_4,
    sill_height="0.1",
    horiz_separ=rh_in_groundfacadewindowwidth)  # -> out, hb_objs; plug-in component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

# ----
daylight_threshold_lux = Panel("1000")
window_transmittance = Panel("0.6")

dayschedule = HBDaySchedule(Decimals=1, Maximum=1, Minimum=0, Value=[0, 0, 0, 0, 0, 0, 0, 0, 0, 1, 1, 1, 1, 1, 1, 1, 1, 1, 0, 0, 0, 0, 0, 0])
constantschedule = HBConstantSchedule(values=dayschedule, name="TestOccup", type_limit="Fractional")  # -> report, schedule, idf_text; plug-in component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

division_2 = Division(A="1", B=window_transmittance)
multiplication_2 = Multiplication(A=daylight_threshold_lux, B=division_2)
concat = Concatenate(FragmentA="a>", FragmentB=multiplication_2)
conditional_statement = Panel(concat)

analysisperiod = LBAnalysisPeriod(
    start_month=Slider(1, range=1..12),
    start_day=Slider(1, range=1..31),
    start_hour=Slider(9, range=1..24),
    end_month=Slider(12, range=1..12),
    end_day=Slider(31, range=1..31),
    end_hour=Slider(17, range=1..24))  # -> period, hoys, dates; plug-in component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
file_path = FilePath("C:\Users\micha\Desktop\Working\Mall analysis\Tokyo-hour.epw")
importepw = LBImportEPW(epw_file=file_path)  # -> location, dry_bulb_temperature, dew_point_temperature, relative_humidity, wind_speed, wind_direction, direct_normal_rad, diffuse_horizontal_rad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; plug-in component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

xdata = LBDeconstructData(data=importepw.diffuse_horizontal_ill)  # -> header, values; plug-in component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
dup = DuplicateData(Data="0", Number="8760", Order=True)
data_2 = LBConstructData(header=xdata.header, values=dup)  # -> data; plug-in component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

dirsolar = LBDirectionalSolarIrradiance(location=importepw.location, direct_norm=importepw.direct_normal_ill, diffuse_horiz=data_2, srf_altitude="90")  # -> out, total, direct, diff, reflect; plug-in component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
wea = HBWeaFromEPW(epw_file=file_path)  # -> wea; plug-in component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
sunpath = LBSunPath(
    north=rh_in_northdirection,
    location=importepw.location,
    hoys=analysisperiod.hoys,
    scale="0.2",
    data=dirsolar.total,
    statement=conditional_statement)  # -> out, vectors, altitudes, azimuths, hoys, sun_pts, analemma, daily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; plug-in component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
legendpar = LBLegendParameters(vert_or_horiz=Toggle(False), text_height=Slider(100, range=0..100))  # -> leg_par; plug-in component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
hours = Panel("250")
panel_2 = Panel("10")
building_depth = Panel(rh_in_buildingdepth)
atrium_area = Panel(rh_in_atriumarea)
typical_floor_height = Panel(rh_in_floorheight)
number_of_levels = Panel(rh_in_levelnumber)
addition = Addition(A=number_of_levels, B="1")
groundfacadewindowwidth = Panel(rh_in_groundfacadewindowwidth)
typicalfacadeglazingratio = Panel(rh_in_typicalfacadeglazingratio)
ground_floor_height = Panel(rh_in_groundheight)
typicalfacadewindowwidth = Panel(rh_in_typicalfacadewindowwidth)
groundfacadeglazingratio = Panel(rh_in_groundfacadeglazingratio)
balcony_width = Panel(rh_in_balcony_roof_offset)
aspect_ratio = Panel(rh_in_aspectratio)
null_item = NullItem(Item=groundfacadewindowwidth)  # -> NullFlags, InvalidFlags, Description
null_item_2 = NullItem(Item=typicalfacadewindowwidth)  # -> NullFlags, InvalidFlags, Description
null_item_3 = NullItem(Item=groundfacadeglazingratio)  # -> NullFlags, InvalidFlags, Description
null_item_4 = NullItem(Item=balcony_width)  # -> NullFlags, InvalidFlags, Description
null_item_5 = NullItem(Item=ground_floor_height)  # -> NullFlags, InvalidFlags, Description
null_item_6 = NullItem(Item=aspect_ratio)  # -> NullFlags, InvalidFlags, Description
null_item_7 = NullItem(Item=atrium_area)  # -> NullFlags, InvalidFlags, Description
null_item_8 = NullItem(Item=typical_floor_height)  # -> NullFlags, InvalidFlags, Description
null_item_9 = NullItem(Item=typicalfacadeglazingratio)  # -> NullFlags, InvalidFlags, Description
null_item_10 = NullItem(Item=number_of_levels)  # -> NullFlags, InvalidFlags, Description
null_item_11 = NullItem(Item=building_depth)  # -> NullFlags, InvalidFlags, Description
ground_floor = Data(surface_4)
surface_5 = Surface(surface_4)
number_slider_3 = Slider(2, range=0..10)
number_slider_4 = Slider(1.5, range=0..10)
boolean_toggle_2 = BooleanToggle(True)
stream_filter = StreamFilter(Gate=null_item.NullFlags, Stream0=groundfacadewindowwidth, Stream1="NaN")
stream_filter_2 = StreamFilter(Gate=null_item_2.NullFlags, Stream0=typicalfacadewindowwidth, Stream1="NaN")
stream_filter_3 = StreamFilter(Gate=null_item_3.NullFlags, Stream0=groundfacadeglazingratio, Stream1="NaN")
stream_filter_4 = StreamFilter(Gate=null_item_9.NullFlags, Stream0=typicalfacadeglazingratio, Stream1="NaN")
stream_filter_5 = StreamFilter(Gate=null_item_4.NullFlags, Stream0=balcony_width, Stream1="NaN")
stream_filter_6 = StreamFilter(Gate=null_item_10.NullFlags, Stream0=number_of_levels, Stream1="NaN")
stream_filter_7 = StreamFilter(Gate=null_item_5.NullFlags, Stream0=ground_floor_height, Stream1="NaN")
stream_filter_8 = StreamFilter(Gate=null_item_6.NullFlags, Stream0=aspect_ratio, Stream1="NaN")
stream_filter_9 = StreamFilter(Gate=null_item_8.NullFlags, Stream0=typical_floor_height, Stream1="NaN")
stream_filter_10 = StreamFilter(Gate=null_item_7.NullFlags, Stream0=atrium_area, Stream1="NaN")
stream_filter_11 = StreamFilter(Gate=null_item_11.NullFlags, Stream0=building_depth, Stream1="NaN")
data_3 = Data(["170", "69", "3", "92", "72", "0.51"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])
labels = Panel("""typicalFacadeGlazingRatio
typicalFacadeWindowWidth
groundFacadeGlazingRatio
groundFacadeWindowWidth
buildingDepth
balconyWidth
atriumArea
aspectRatio
groundFloorHeight
typicalfloorHeight
numberLevels
groundSDA
firstSDA
groundASE
firstASE
groundViewPercent
firstViewPercent""")
sad_ase_seed_2 = Data(reverse(Tree({0}: ["0.7 2 0.8 4 20 1 2500 0.8 3.3 2.9 6 68.3 55.2 23.4 15.0"], {1}: ["0.7 3 0.8 2 15 6 3200 1.1 4.8 2.9 5 100.0 44.9 28.1 11.8"], {2}: ["0.8 4 0.9 3 18 1 1600 1.1 4.8 2.7 10 100.0 47.0 26.5 12.9"], {3}: ["0.8 4 0.7 4 36 3 1700 0.7 4.1 2.6 3 45.8 25.8 14.0 7.7"], {4}: ["0.8 2 0.8 3 18 1 3600 1.1 3.1 2.5 1 95.5 64.4 21.1 21.5"], {5}: ["0.8 4 0.9 3 31 3 3500 1.1 3.1 2.5 7 39.0 22.3 9.6 8.0"]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)))
data_4 = Data(Tree({0}: ["170 69 3 92 72 0.51 7 6 8 2204.0 83456 6624 54 119016 4420 100.0 100.0"], {1}: ["184 81 6 77 87 0.94 6 4 4 2279.0 39292 6699 23 52417 4420 100.0 94.4"], {2}: ["167 58 3 81 61 0.7 5 6 8 1269.0 65064 4941 52 65988 3672 100.0 100.0"], {3}: ["24 78 2 90 80 0.78 5 4 9 2576 102600 7200 42 108192 4624 100.0 79.0"], {4}: ["63 53 5 52 58 0.78 4 6 2 432.0 10160 3016 15 6480 2584 92.6 100.0"], {5}: ["234 74 4 50 78 0.6 7 4 7 704.0 45864 3900 36 25344 3196 100.0 81.4"]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))
data_5 = Data(["northDir buildingDepth balconyWidth siteWidth siteLength floorDepth groundHeight typicalHeight levelNo skylightArea netTotalArea netGroundArea buildingHeight atriumVolume roofArea groundSDA firstSDA", "170 69 3 92 72 0.51 7 6 8 2204.0 83456 6624 54 119016 4420 100.0 100.0", "184 81 6 77 87 0.94 6 4 4 2279.0 39292 6699 23 52417 4420 100.0 94.4", "167 58 3 81 61 0.7 5 6 8 1269.0 65064 4941 52 65988 3672 100.0 100.0", "24 78 2 90 80 0.78 5 4 9 2576 102600 7200 42 108192 4624 100.0 79.0", "63 53 5 52 58 0.78 4 6 2 432.0 10160 3016 15 6480 2584 92.6 100.0"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])

# ---- group: skylight
series = Series(Start=rh_in_groundheight, Step=rh_in_floorheight, Count=rh_in_levelnumber)
list_item = ListItem(List=series, Index=expr("-1", 0), Wrap=True)
addition_2 = Addition(A=list_item, B=rh_in_floorheight)
unit_z_4 = UnitZ(Factor=addition_2)
curve_3 = Curve(orient.Geometry)
move = Move(Geometry=curve_3, Motion=unit_z_4)  # -> Geometry, Transform
unit_z_5 = UnitZ(Factor=rh_in_skylight_roof_offset)
move_2 = Move(Geometry=move.Geometry, Motion=unit_z_5)  # -> Geometry, Transform
curve_4 = Curve(move_2.Geometry)
loft_2 = Loft(
    Curves=[move_2.Geometry, move.Geometry],
    Options={Adjust=False, Closed=False, LoftEnds=0, LoftSimp=0, LoftType=0, Rebuild=10, Refit=0.01})
surface_6 = Surface(curve_4)

# ----
unit_z_6 = UnitZ(Factor=addition_2)
curve_5 = Curve(move.Geometry)

# ---- group: typical floor volume
Z_2 = UnitZ(Factor=series)
move_3 = Move(Geometry=srfsplit, Motion=Z_2)  # -> simplify(Geometry), Transform
repeat = RepeatData(Data=rh_in_floorheight, Length=rh_in_levelnumber)
lng = ListLength(List=move_3.Geometry)
series_2 = Series(Start=0, Step=1, Count=lng)
Z_3 = UnitZ(Factor=1)
replace = ReplaceItems(List=move_3.Geometry, Item=repeat, Indices=series_2, Wrap=False)
amp = Amplitude(Vector=Z_3, Amplitude=replace)  # -> simplify(Vector)

# ----
move_4 = Move(Geometry=offset_curve, Motion=unit_z_6)  # -> Geometry, Transform
boundary_surfaces_2 = BoundarySurfaces(Edges=[curve_5, move_4.Geometry])
deconstruct_brep_2 = DeconstructBrep(Brep=boundary_surfaces_2)  # -> Faces, Edges, Vertices
surface_7 = Surface(deconstruct_brep_2.Faces)
move_5 = Move(Geometry=surface_7, Motion=negative)  # -> Geometry, Transform

# ---- group: skylight / Skylight
merge = Merge(Data1=loft_2, Data2=surface_6)

# ----
offset_surface = OffsetSurface(Surface=move_5.Geometry, Distance=unit_z_3, BothSides=0, CreateSolid=True)

# ---- group: skylight (continued)
custom_preview = CustomPreview(Geometry=merge, Material=ColourSwatch(SwatchColor=RGBA(45, 38, 252, 41)))

# ---- group: typical floor volume / Typical Floor volumes
extr_2 = Extrude(Base=move_3.Geometry, Direction=amp)  # -> flatten(Extrusion)

# ---- group: Roof
custom_preview_2 = CustomPreview(Geometry=offset_surface, Material=ColourSwatch(SwatchColor=RGB(186, 182, 182)))

# ----
deconstruct_brep_3 = DeconstructBrep(Brep=offset_surface)  # -> Faces, Edges, Vertices
area_2 = Area(Geometry=deconstruct_brep_3.Faces)  # -> Area, Centroid
deconstruct = Deconstruct(Point=area_2.Centroid)  # -> XComponent, YComponent, ZComponent
sort_list = SortList(Keys=deconstruct.ZComponent, ValuesValuesA=deconstruct_brep_3.Faces)  # -> Keys, ValuesValuesA

# ---- group: roof ceiling
list_item_2 = ListItem(List=sort_list.ValuesValuesA, Index=0, Wrap=True)

# ----
# show curves, suns, legend
# label suns
# visualization params.
# show only some suns per day
# show only some suns per day
# visualize the solstices
# adjust sun path scale to fit site
# and choose daily sun path
# adjust legend bounds and visualization
area_3 = Area(Geometry=move_5.Geometry)  # -> Area, Centroid
multiplication_3 = Multiplication(A=area_3.Area, B=addition)
one_over_x = OneOverX(Value=multiplication_3)
wlc_gross_floor_area_maximise = Data(one_over_x)

# ---- group: Roof
geometry = Geometry(offset_surface)

# ---- group: skylight
geometry_2 = Geometry(merge)

# ---- group: balcony
unit_z_7 = UnitZ(Factor=series)
move_6 = Move(Geometry=curve_3, Motion=unit_z_7)  # -> simplify(Geometry), Transform
negative_3 = Negative(Value=rh_in_balcony_roof_offset)
offset_curve_2 = OffsetCurve(Curve=move_6.Geometry, Distance=negative_3, Corners=1)  # -> simplify(Curve)
graft_tree = GraftTree(Tree=move_6.Geometry, IncludeEmptyLists=True, IncludeNullItems=True)
graft_tree_2 = GraftTree(Tree=offset_curve_2, IncludeEmptyLists=True, IncludeNullItems=True)
insert_items = InsertItems(List=graft_tree, Item=graft_tree_2, Indices="0", Wrap=True)  # -> simplify(List)
negative_4 = Negative(Value=rh_in_balcony_depth)

# ----
move_7 = Move(Geometry=offset_curve, Motion=unit_z_7)  # -> simplify(Geometry), Transform
extrude = Extrude(Base=move_7.Geometry, Direction=unit_z)
deconstruct_brep_4 = DeconstructBrep(Brep=extrude)  # -> Faces, Edges, Vertices

# ---- group: Typical outer facade
surface_8 = Surface(deconstruct_brep_4.Faces)

# ---- group: balcony / Balconies
boundary_surfaces_3 = BoundarySurfaces(Edges=insert_items)

# ----
custom_preview_3 = CustomPreview(Geometry=[surface_8, extr], Material=ColourSwatch(SwatchColor=RGBA(8, 0, 252, 152)))

# ---- group: balcony (continued)
offset_surface_2 = OffsetSurface(Surface=boundary_surfaces_3, Distance=negative_4, BothSides=0, CreateSolid=True)
custom_preview_4 = CustomPreview(Geometry=offset_surface_2, Material=ColourSwatch(SwatchColor=RGB(255, 72, 69)))

# ----
brep = Brep(offset_surface_2)
deconstruct_brep_5 = DeconstructBrep(Brep=brep)  # -> Faces, Edges, Vertices
area_4 = Area(Geometry=deconstruct_brep_5.Faces)  # -> Area, Centroid
deconstruct_2 = Deconstruct(Point=area_4.Centroid)  # -> XComponent, YComponent, ZComponent
sort_list_2 = SortList(Keys=deconstruct_2.ZComponent, ValuesValuesA=deconstruct_brep_5.Faces)  # -> Keys, ValuesValuesA

# ---- group: balcony ceiling
list_item_3 = ListItem(List=sort_list_2.ValuesValuesA, Index=0, Wrap=True)

# ----
typical_outer_facade = Data(surface_8)
surface_9 = Surface(typical_outer_facade)
face_2 = HBFace(geo=surface_9, rad_mod=opaquemod)  # -> out, faces; plug-in component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

# ---- group: External upper floors
aperturesbyratio_2 = HBAperturesByRatio(
    hb_objs=flatten(face_2.faces),
    ratio=rh_in_typicalfacadeglazingratio,
    win_height=subtraction_3,
    sill_height="0.1",
    horiz_separ=rh_in_typicalfacadewindowwidth)  # -> out, hb_objs; plug-in component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

# ---- group: Floors
unit_z_8 = UnitZ(Factor=series)
curve_6 = Curve(offset_curve)
move_8 = Move(Geometry=curve_6, Motion=unit_z_8)  # -> simplify(Geometry), Transform
graft_tree_3 = GraftTree(Tree=move_8.Geometry, IncludeEmptyLists=True, IncludeNullItems=True)
insert_items_2 = InsertItems(List=graft_tree_3, Item=graft_tree, Indices="0", Wrap=True)  # -> simplify(List)
negative_5 = Negative(Value=rh_in_floor_depth)
boundary_surfaces_4 = BoundarySurfaces(Edges=insert_items_2)

offset_surface_3 = OffsetSurface(Surface=boundary_surfaces_4, Distance=negative_5, BothSides=0, CreateSolid=True)

# ----
brep_2 = Brep(offset_surface_3)
deconstruct_brep_6 = DeconstructBrep(Brep=brep_2)  # -> Faces, Edges, Vertices
deconstruct_brep_7 = DeconstructBrep(Brep=offset_surface_3)  # -> Faces, Edges, Vertices
area_5 = Area(Geometry=deconstruct_brep_6.Faces)  # -> Area, Centroid
deconstruct_3 = Deconstruct(Point=area_5.Centroid)  # -> XComponent, YComponent, ZComponent
area_6 = Area(Geometry=deconstruct_brep_7.Faces)  # -> Area, Centroid
deconstruct_4 = Deconstruct(Point=area_6.Centroid)  # -> XComponent, YComponent, ZComponent
sort_list_3 = SortList(Keys=deconstruct_3.ZComponent, ValuesValuesA=deconstruct_brep_6.Faces)  # -> Keys, ValuesValuesA
sort_list_4 = SortList(Keys=deconstruct_4.ZComponent, ValuesValuesA=deconstruct_brep_7.Faces)  # -> Keys, ValuesValuesA

# ---- group: Ground ceiling
list_item_4 = ListItem(List=sort_list_3.ValuesValuesA, Index=0, Wrap=True)

# ---- group: floor surface
list_item_5 = ListItem(List=sort_list_4.ValuesValuesA, Index=expr("-1", 0), Wrap=True)  # -> simplify(Item)

# ---- group: Floors (continued)
custom_preview_5 = CustomPreview(Geometry=offset_surface_3, Material=ColourSwatch(SwatchColor=RGB(255, 196, 0)))

# ----
merge_2 = Merge(Data1=list_item_4, Data2=list_item_3)

# ---- group: all ceilings
surface_10 = Surface(merge_2)

surface_11 = Surface([surface_10, list_item_2])

# ---- group: upper floor surfaces
surface_12 = Surface(list_item_5)

# ---- group: upper floors
geometry_3 = Geometry(offset_surface_3)

# ----
merge_3 = Merge(Data1=geometry_3, Data2=sitegeometry)
merge_4 = Merge(Data1=sitegeometry, Data2=surface_12)  # -> flatten(Result)
surface_13 = Surface(surface_11)
surface_14 = Surface(merge_4)
list_item_6 = ListItem(List=flatten(surface_12), Index="0", Wrap=True)
face_3 = HBFace(geo=surface_14, rad_mod=opaquemod_4)  # -> out, faces; plug-in component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
face_4 = HBFace(geo=surface_13, rad_mod=opaquemod_5)  # -> out, faces; plug-in component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
merge_5 = Merge(Data1=surface_4, Data2=list_item_6)  # -> flatten(Result)
genpts = LBGeneratePointGrid(geometry=merge_5, grid_size=Slider(3, range=0..10), offset_dist=Slider(0.75, range=0..1))  # -> points, vectors, face_areas, graft(mesh); plug-in component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
sensorgrid = HBSensorGrid(positions=genpts.points)  # -> grid; plug-in component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
first_floor = Data(list_item_6)

# ---- group: inner facades
subtraction_5 = Subtraction(A=rh_in_floorheight, B=rh_in_floor_depth)
unit_z_9 = UnitZ(Factor=subtraction_5)
subtraction_6 = Subtraction(A=rh_in_groundheight, B=rh_in_floor_depth)
crv_5 = Curve(simplify(flatten(orient.Geometry)))
extrude_2 = Extrude(Base=graft_tree, Direction=unit_z_9)
Z_4 = UnitZ(Factor=subtraction_6)
deconstruct_brep_8 = DeconstructBrep(Brep=extrude_2)  # -> Faces, Edges, Vertices

# ---- group: inner facades / Ground inner facade
extr_3 = Extrude(Base=crv_5, Direction=Z_4)

# ---- group: inner facades / Typical inner facade
surface_15 = Surface(deconstruct_brep_8.Faces)

# ---- group: inner facades (continued)
deconstruct_brep_9 = DeconstructBrep(Brep=extr_3)  # -> Faces, Edges, Vertices

# ---- group: inner facades / all inner facades
merge_6 = Merge(Data1=surface_15, Data2=deconstruct_brep_9.Faces)  # -> flatten(Result)
custom_preview_6 = CustomPreview(Geometry=[surface_15, extr_3], Material=ColourSwatch(SwatchColor=RGBA(8, 0, 252, 152)))

# ---- group: internal glazing
geometry_4 = Geometry(merge_6)

# ----
merge_7 = Merge(Data1=geometry_4, Data2=typical_outer_facade, Data3=geometry_2, Data4=ground_outer_facade)  # disabled
custom_preview_7 = CustomPreview(Geometry=merge_7, Material=colour_swatch)  # disabled
surface_16 = Surface(geometry_4)
face_5 = HBFace(geo=surface_16, rad_mod=opaquemod_3)  # -> out, faces; plug-in component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
aperturesbyratio_3 = HBAperturesByRatio(hb_objs=flatten(face_5.faces), ratio=0.9)  # -> out, hb_objs; plug-in component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
merge_8 = Merge(
    Data1=aperturesbyratio_2.hb_objs,
    Data2=aperturesbyratio.hb_objs,
    Data3=face_3.faces,
    Data4=face_4.faces,
    Data5=aperturesbyratio_3.hb_objs)
model = HBModel(faces=flatten(merge_8))  # -> out, model; plug-in component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
vizbytype = HBVisualizeByType(hb_objs=model.model)  # -> walls, interior_walls, roofs, ceilings, exterior_floors, interior_floors, air_walls, apertures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; plug-in component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
mesh = Mesh(flatten([vizbytype.walls, vizbytype.interior_walls, vizbytype.roofs, vizbytype.ceilings, vizbytype.exterior_floors, vizbytype.interior_floors, vizbytype.air_walls, vizbytype.apertures, vizbytype.interior_apertures, vizbytype.doors, vizbytype.interior_doors, vizbytype.outdoor_shades, vizbytype.indoor_shades]))
assigngridsviews = HBAssignGridsAndViews(model=model.model, grids=flatten(sensorgrid))  # -> model; plug-in component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
mesh_2 = Mesh(vizbytype.apertures)
annualdaylight = HBAnnualDaylight(model=assigngridsviews, wea=wea, north=rh_in_northdirection, schedule=constantschedule.schedule, run=boolean_toggle)  # -> out, results, DA, cDA, UDI, UDI_low, UDI_up; plug-in component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
panel_3 = Panel(annualdaylight.DA)
mesh_3 = Mesh([vizbytype.walls, vizbytype.roofs, vizbytype.exterior_floors])
heatmap = LBSpatialHeatmap(values=annualdaylight.DA, mesh=genpts.mesh, legend_par=legendpar)  # -> mesh, legend, title, colors, legend_par; plug-in component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
directsunhours = LBDirectSunHours(
    vectors=flatten(sunpath.vectors),
    geometry=graft(merge_5),
    context=flatten(mesh_3),
    grid_size="3",
    offset_dist=".1",
    run=boolean_toggle)  # -> out, points, simplify(results), mesh, legend, title, int_mtx; plug-in component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
results = Data(directsunhours.results)
mesh_4 = Mesh(vizbytype.exterior_floors)
mesh_5 = Mesh(vizbytype.walls)
merge_9 = Merge(Data1=mesh_4, Data2=surface_5, Data3=mesh_5)
viewpercent = LBViewPercent(
    view_type="0",
    geometry=flatten(first_floor),
    context=flatten(merge_9),
    grid_size=number_slider_3,
    offset_dist=number_slider_4,
    run=boolean_toggle_2)  # -> out, points, view_vecs, results, mesh, legend, title, int_mtx; plug-in component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
viewpercent_2 = LBViewPercent(
    view_type="0",
    geometry=flatten(ground_floor),
    context=flatten(merge_9),
    grid_size=number_slider_3,
    offset_dist=number_slider_4,
    run=boolean_toggle_2)  # -> out, points, view_vecs, results, mesh, legend, title, int_mtx; plug-in component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
panel_4 = Panel(viewpercent.results)
panel_5 = Panel(viewpercent_2.results)
list_length = ListLength(List=viewpercent.results)
mass_addition = MassAddition(Input=panel_4)  # -> Result, PartialResults
division_3 = Division(A=mass_addition.Result, B=list_length)
list_length_2 = ListLength(List=viewpercent_2.points)
mass_addition_2 = MassAddition(Input=panel_5)  # -> Result, PartialResults
division_4 = Division(A=mass_addition_2.Result, B=list_length_2)
panel_6 = Panel(division_3)
first_floor_view = Panel(panel_6)
null_item_12 = NullItem(Item=first_floor_view)  # -> NullFlags, InvalidFlags, Description
stream_filter_12 = StreamFilter(Gate=null_item_12.NullFlags, Stream0=first_floor_view, Stream1="NaN")
panel_7 = Panel(division_4)
addition_3 = Addition(A=panel_6, B=panel_7)
one_over_x_2 = OneOverX(Value=addition_3)
wlc_views_maximize = Number(one_over_x_2)
ground_floor_view = Panel(panel_7)
null_item_13 = NullItem(Item=ground_floor_view)  # -> NullFlags, InvalidFlags, Description
stream_filter_13 = StreamFilter(Gate=null_item_13.NullFlags, Stream0=ground_floor_view, Stream1="NaN")

larger_than = LargerThan(FirstNumber=annualdaylight.DA, SecondNumber="50")  # -> LargerThan, OrEqualTo
ma = MassAddition(Input=larger_than.OrEqualTo)  # -> Result, PartialResults
lng_2 = ListLength(List=annualdaylight.DA)
eval = Evaluate(F="format(\"{0:0.0}\",x/y*100)", x=ma.Result, y=lng_2)  # -> simplify(r)
larger = LargerThan(FirstNumber=flatten(eval), SecondNumber=graft("50"))  # -> LargerThan, OrEqualTo

explode_tree = ExplodeTree(Data=eval)  # -> Branch0, Branch1
weave = Weave(Pattern=graft(larger.LargerThan), Stream0="You have Failed LEED.", Stream1="You have Passed LEED!", NullGaps=False)
concat_2 = Concatenate(FragmentA=eval, FragmentB="%")
portion_of_space_with_250_hours = Panel(concat_2)

leed_status_of_your_geometry = Panel(weave)

ground_floor_sda = Panel(explode_tree.Branch0)
first_floor_sda = Panel(explode_tree.Branch1)
addition_4 = Addition(A=ground_floor_sda, B=first_floor_sda)
one_over_x_3 = OneOverX(Value=addition_4)
wlc_daylight_maximise = Number(one_over_x_3)
null_item_14 = NullItem(Item=ground_floor_sda)  # -> NullFlags, InvalidFlags, Description
null_item_15 = NullItem(Item=first_floor_sda)  # -> NullFlags, InvalidFlags, Description
stream_filter_14 = StreamFilter(Gate=null_item_15.NullFlags, Stream0=first_floor_sda, Stream1="NaN")
stream_filter_15 = StreamFilter(Gate=null_item_14.NullFlags, Stream0=ground_floor_sda, Stream1="NaN")

larger_than_2 = LargerThan(FirstNumber=results, SecondNumber=hours)  # -> LargerThan, OrEqualTo
lng_3 = ListLength(List=directsunhours.results)
ma_2 = MassAddition(Input=larger_than_2.OrEqualTo)  # -> Result, PartialResults
eval_2 = Evaluate(F="format(\"{0:0.0}\",x/y*100)", x=ma_2.Result, y=lng_3)  # -> simplify(r)
larger_2 = LargerThan(FirstNumber=flatten(eval_2), SecondNumber=graft(panel_2))  # -> LargerThan, OrEqualTo
concat_3 = Concatenate(FragmentA=eval_2, FragmentB="%")
portion_of_space_with_250_hours_2 = Panel(concat_3)

explode_tree_2 = ExplodeTree(Data=eval_2)  # -> Branch0, Branch1
ground_floor_sda_2 = Panel(explode_tree_2.Branch0)
first_floor_sda_2 = Panel(explode_tree_2.Branch1)
addition_5 = Addition(A=ground_floor_sda_2, B=first_floor_sda_2)
wlc_glare_minimize = Number(addition_5)
wallacei_x = WallaceiX(
    Genes=[wlc_1, wlc_10, wlc_11, wlc_12, wlc_2, wlc_3, wlc_4, wlc_5, wlc_6, wlc_7, wlc_8, wlc_9],
    Objectives=flatten([wlc_gross_floor_area_maximise, wlc_daylight_maximise, wlc_views_maximize, wlc_glare_minimize]),
    Phenotype=mesh,
    allFitness="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",
    allFrontIdx="0|0;0|1;0|2;0|3;0|4;0|5;0|6;0|7;0|8;0|9;0|10;0|11;0|12;0|13;0|14;0|15;0|16;0|17;0|18;0|19;0|20;0|21;0|22;0|23;0|24;1|0;1|1;1|2;1|3;1|4;1|5;1|6;1|7;1|8;1|9;1|10;1|11;1|12;1|13;1|14;1|15;1|16;1|17;1|18;1|19;1|20;1|21;1|22;1|23;1|24",
    allGenomes="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",
    curFrontIdx="1|0;1|1;1|2;1|3;1|4;1|5;1|6;1|7;1|8;1|9;1|10;1|11;1|12;1|13;1|14;1|15;1|16;1|17;1|18;1|19;1|20;1|21;1|22;1|23;1|24",
    curFrontIdxSave="0|0;0|1;0|2;0|3;0|4;0|5;0|6;0|7;0|8;0|9;0|10;0|11;0|12;0|13;0|14;0|15;0|16;0|17;0|18;0|19;0|20;0|21;0|22;0|23;0|24;1|0;1|1;1|2;1|3;1|4;1|5;1|6;1|7;1|8;1|9;1|10;1|11;1|12;1|13;1|14;1|15;1|16;1|17;1|18;1|19;1|20;1|21;1|22;1|23;1|24",
    popGen="25,50",
    total="33719078",
    wlcDone=True)  # -> WallaceiGenomes, FitnessValues, Data, WPhenotypes
pdecoder = DecodePhenotype(WallaceiPhenotype=wallacei_x.WPhenotypes)  # -> simplify(GeometriesList), MeshesList, NumbersList, TextList
gdecoder = DecodeGenome(WallaceiGenome=wallacei_x.WallaceiGenomes)
panel_8 = Panel(wallacei_x.FitnessValues)
panel_9 = Panel(gdecoder)
pshift_2 = ShiftPaths(Data=pdecoder.GeometriesList, Offset=-1)
geo = Geometry(pdecoder.GeometriesList)
geo_2 = Geometry(pdecoder.MeshesList)
join = BrepJoin(Breps=geo)  # -> Breps, Closed
pshift_3 = ShiftPaths(Data=pdecoder.GeometriesList, Offset=-2)
# show curves, suns, legend
# Tag EXTERIOR glazing as VisionGlass
# Do NOT tag interior glazing!
# label suns
viewer = ParamViewer(pshift_2)
branch_2 = TreeBranch(Tree=gdecoder, Path=viewer, MaintainPaths=True)
viewer_2 = ParamViewer(pshift_3)
branch_3 = TreeBranch(Tree=wallacei_x.FitnessValues, Path=viewer_2, MaintainPaths=True)
panel_10 = Panel(branch_2)
panel_11 = Panel(branch_3)
null_item_16 = NullItem(Item=ground_floor_sda_2)  # -> NullFlags, InvalidFlags, Description
null_item_17 = NullItem(Item=first_floor_sda_2)  # -> NullFlags, InvalidFlags, Description
weave_2 = Weave(Pattern=graft(larger_2.LargerThan), Stream0="You have Passed LEED!", Stream1="You have Failed LEED.", NullGaps=False)

leed_status_of_your_geometry_2 = Panel(weave_2)

stream_filter_16 = StreamFilter(Gate=null_item_16.NullFlags, Stream0=ground_floor_sda_2, Stream1="NaN")
stream_filter_17 = StreamFilter(Gate=null_item_17.NullFlags, Stream0=first_floor_sda_2, Stream1="NaN")

# ---- group: writer
merge_10 = Merge(
    Data1=flatten(stream_filter_4),
    Data2=flatten(stream_filter_2),
    Data3=flatten(stream_filter_3),
    Data4=flatten(stream_filter),
    Data5=flatten(stream_filter_11),
    Data6=flatten(stream_filter_5),
    Data7=flatten(stream_filter_10),
    Data8=flatten(stream_filter_8),
    Data9=flatten(stream_filter_7),
    Data10=flatten(stream_filter_9),
    Data11=flatten(stream_filter_6),
    Data12=flatten(stream_filter_15),
    Data13=flatten(stream_filter_14),
    Data14=flatten(stream_filter_16),
    Data15=flatten(stream_filter_17),
    Data16=flatten(stream_filter_13),
    Data17=flatten(stream_filter_12))  # -> simplify(Result)
num = Number(number_slider)

# ----
data_6 = Data(merge_10)
data_rec = PythonScript(x=data_6, enable=Toggle(True), reset=Button(), limit=Slider(0, range=0..10))  # -> x; inputs x: tree, enable: Boolean, reset: Boolean, limit: Int32
# ---------- data_rec: Python ----------
from Grasshopper import DataTree
if reset or 'rec' not in globals(): rec = DataTree[object]()
if enable and not reset: rec.MergeTree(x)
if limit > 0:
  for branch in rec.Branches:
    if branch.Count > limit:
      branch.RemoveRange(0, branch.Count - limit)
x = rec
# ---------- end data_rec ----------
param_viewer = ParamViewer(merge_10)
panel_12 = Panel(data_rec)
partition_list = PartitionList(List=panel_12, Size="17")  # -> simplify(Chunks)

# ---- group: writer (continued)
join_2 = TextJoin(Text=partition_list, Join=" ")  # -> simplify(Result)

# ----
flip_matrix = FlipMatrix(Data=join_2)
panel_13 = Panel(join_2)
create_csv = CreateCSV(DataGridHeaders=simplify(labels), ValueTree=simplify(flip_matrix), Delimiter=",")
panel_14 = Panel(create_csv)
