# Grasshopper definition Iteration-5-Hops-LEED-Score.gh (Grasshopper 1.0.7)
# plug-ins: Hops, Pufferfish

concatenate = Concatenate(FragmentA="http://8b70-34-86-147-173.ngrok.io", FragmentB="/myAtriumDaylightingView")
atriumarea = Slider(4000, range=1000..4000)
groundfloorheight = Slider(4, range=4..6)
typicalfloorheight = Slider(3, range=2..3)
numberlevels = Slider(6, range=1..10)
panel = Panel(concatenate)
hops = Hops(
    _Path=concatenate,
    TypicalFacadeWindowWidth=Slider(2, range=2..4),
    GroundFacadeWindowWidth=Slider(2, range=2..4),
    BuildingDepth=Slider(40, range=15..40),
    BalconyWidth=Slider(3.9, range=1..6),
    AtriumArea=atriumarea,
    AspectRatio=Slider(0.5, range=0.5..1.5),
    GroundFloorHeight=groundfloorheight,
    TypicalfloorHeight=typicalfloorheight,
    NumberLevels=numberlevels,
    CacheResultsInMemory=True,
    CacheSolveResults=True,
    RemoteDefinitionLocation="http://8b70-34-86-147-173.ngrok.io/myAtriumDaylightingView",
    RemoteSolveVersion=(0, 1, 0),
    ShowInput_Enabled=False,
    ShowInput_Path=True,
    SynchronousSolve=True)  # -> GroundSDA, FirstSDA, GroundASE, FirstASE, GroundViewPercentage, FirstViewPercentage
panel_2 = Panel(hops.GroundASE)
panel_3 = Panel(hops.FirstASE)
panel_4 = Panel(hops.GroundSDA)
panel_5 = Panel(hops.FirstSDA)
panel_6 = Panel(hops.GroundViewPercentage)
panel_7 = Panel(hops.FirstViewPercentage)
number = Number([panel_4, panel_5, panel_2, panel_3, panel_6, panel_7])
round_to_decimal_place = RoundToDecimalPlace(NumberX=number, DecimalPlace="2", RoundType=0)  # -> Rounded, Difference
list_item = ListItem(List=round_to_decimal_place.Rounded, Index=0, Wrap=True)  # -> Item, Item1, Item2, Item3, Item4, Item5
panel_8 = Panel(round_to_decimal_place.Rounded)
ghpython_script = GhPythonScript(
    groundSDA=list_item.Item,
    firstSDA=list_item.Item1,
    groundASE=list_item.Item2,
    firstASE=list_item.Item3,
    groundview=list_item.Item4,
    firstview=list_item.Item5)  # -> out, LEED_Score_Daylit, LEED_Score_Glare, LEED_Score_View, Total_LEED_points
# ---------- ghpython_script: Python ----------
__author__ = "Dell"
__version__ = "2022.06.12"

import math
import rhinoscriptsyntax as rs

# Daylit SDA
LEED_points_daylit = 0
LEED_points_Glare = 0
LEED_points_View = 0


if ((54 < groundSDA < 74) & (54 < firstSDA < 74)):
    LEED_points_daylit = 2
    print( 'LEED points of Daylit =' + LEED_points_daylit)
elif ((groundSDA >74) & (firstSDA >74)):
     LEED_points_daylit = 3
     print( 'LEED points of Daylit =' + LEED_points_daylit)
else:
     print('No LEED points are gained')
    
    
#Daylit Glare index 

if ((groundASE<11) & (firstASE<11)):
    LEED_points_Glare = 1
    print(LEED_points_Glare)


if ((groundview >74) & (firstview > 74)):
    LEED_points_View = 1
    print(LEED_points_View)
    
    



LEED_Score_Daylit=LEED_points_daylit 

LEED_Score_Glare=LEED_points_Glare 

LEED_Score_View=LEED_points_View 

Total_LEED_points = LEED_points_daylit + LEED_points_Glare + LEED_points_View
# ---------- end ghpython_script ----------
panel_9 = Panel(ghpython_script.LEED_Score_Daylit)
panel_10 = Panel(ghpython_script.LEED_Score_Glare)
panel_11 = Panel(ghpython_script.LEED_Score_View)
panel_12 = Panel(ghpython_script.Total_LEED_points)
